# Dynamo graph Grid Layout_001.dyn (Dynamo 2.1.0.5784)

select_model_elements = DSModelElementsSelection()  # 1 picked in the model
geometry = Element.Geometry(element=select_model_elements)
firstItem = List.FirstItem(list=geometry)
code_block = CodeBlock()
# ---------- code_block.designscript (8 lines) ----------
def isCCW(curve, A, parameter)
{
B = curve.PointAtParameter(parameter+0.00001);
v1 = curve.NormalAtParameter(parameter);
C = A.Add(v1);
test = (B.X - A.X) * (C.Y - A.Y) >(B.Y - A.Y) * (C.X - A.X);
return = test ? v1 : v1.Reverse();
};
# ----------------------------------------
element_types = ElementTypes(index=270)
all_elements_of_type = ElementsOfType(element_type=element_types)
firstItem_2 = List.FirstItem(list=all_elements_of_type)
family_types = FamilyTypes(index=19)
code_block_2 = CodeBlock(x=all_elements_of_type) { listYo = List.Transpose(x); get = List.GetItemAtIndex(listYo, 1); }
geometry_2 = Element.Geometry(element=code_block_2.get)
bySolid = PolySurface.BySolid(solid=geometry_2)
surfaces = PolySurface.Surfaces(polySurface=bySolid)
number_slider = DoubleSlider(3, range=0..100 step 0.1)
getItemAtIndex = List.GetItemAtIndex(list=surfaces@L2, index=number_slider)
firstItem_3 = List.FirstItem(list=getItemAtIndex)
firstItem_4 = List.FirstItem(list=firstItem_3)
perimeterCurves = Surface.PerimeterCurves(surface=firstItem_4)
byJoinedCurves = PolyCurve.ByJoinedCurves(curves=perimeterCurves)
code_block_3 = CodeBlock { 0..1..#100; }
pointAtParameter = Curve.PointAtParameter(curve=byJoinedCurves, param=code_block_3)
code_block_4 = CodeBlock(c1=byJoinedCurves, a=pointAtParameter, par1=code_block_3) { isCCW(c1,a,par1); }
code_block_5 = CodeBlock { 4; }
byStartPointDirectionLength = Line.ByStartPointDirectionLength(startPoint=pointAtParameter, direction=code_block_4, length=code_block_5)
levels = Levels(index=0)
byLine = archilab.Revit.Elements.FamilyInstances.ByLine(familyType=family_types, line=byStartPointDirectionLength, level=levels)  # frozen
firstItem_5 = List.FirstItem(list=perimeterCurves)
code_block_6 = CodeBlock { 1; -40.594; }
byTangency = Line.ByTangency(curve=firstItem_5, parameter=code_block_6.out0)
startPoint = Curve.StartPoint(curve=firstItem_5)
endPoint = Curve.EndPoint(curve=firstItem_5)
byStartPointEndPoint = Line.ByStartPointEndPoint(startPoint=startPoint, endPoint=endPoint)
code_block_7 = CodeBlock { x = FamilyInstances.GetMaterials(fam); location = FamilyInstances.SetLocation(fam, (0..#10..1)); }  # unwired: fam
parse = Custom[Springs.InterferenceCheck.Parse]()  # Process a Revit interference check (HTML file) and extract the interference categories, all affected elements and the total number of clashes. If you are executing from a document different than the one the error report belongs to, be sure to set "fetch_elements" to false.; unwired: report
byPointAndLevel = FamilyInstance.ByPointAndLevel(familyType=family_types, point=pointAtParameter, level=levels)
code_block_8 = CodeBlock { 90; }
setRotation = FamilyInstance.SetRotation(familyInstance=byPointAndLevel, degree=code_block_8)
code_block_9 = CodeBlock { 1; }
getItemAtIndex_2 = List.GetItemAtIndex(list=all_elements_of_type, index=code_block_9)
code_block_10 = CodeBlock {  }
