# Dynamo graph Grid Layout_003.dyn (Dynamo 2.1.0.5784)

select_model_elements = DSModelElementsSelection()  # 1 picked in the model
geometry = Element.Geometry(element=select_model_elements)
firstItem = List.FirstItem(list=geometry)
code_block = CodeBlock()
# ---------- code_block.designscript (8 lines) ----------
def isCCW(curve, A, parameter)
{
B = curve.PointAtParameter(parameter+0.00001);
v1 = curve.NormalAtParameter(parameter);
C = A.Add(v1);
test = (B.X - A.X) * (C.Y - A.Y) >(B.Y - A.Y) * (C.X - A.X);
return = test ? v1 : v1.Reverse();
};
# ----------------------------------------
family_types = FamilyTypes(index=19)
all_elements_of_model_category = ModelCategoriesCollect(index=84)
code_block_2 = CodeBlock(t1=all_elements_of_model_category)
# ---------- code_block_2.designscript (8 lines) ----------
t2 = t1;
x = t2;
listYo = List.Transpose(x);
get = List.GetItemAtIndex(listYo, 0);
t3 = List.GetItemAtIndex(t2, 1);
t4 = Elements.Element.Geometry(get);
polySurface1 = PolySurface.BySolid(t4);
surface1 = PolySurface.Surfaces(polySurface1);
# ----------------------------------------
number_slider = DoubleSlider(7, range=0..100 step 0.1)
code_block_3 = CodeBlock(surface1=code_block_2.surface1, t2=number_slider)  # frozen
# ---------- code_block_3.designscript (4 lines) ----------
t1 = List.GetItemAtIndex(surface1@L2<1>, t2);
t3 = List.FirstItem(t1);
t4 = List.FirstItem(t3);
curve1 = Surface.PerimeterCurves(t4);
# ----------------------------------------
byJoinedCurves = PolyCurve.ByJoinedCurves(curves=code_block_3.curve1)
code_block_4 = CodeBlock { 0..1..#100; }
pointAtParameter = Curve.PointAtParameter(curve=byJoinedCurves, param=code_block_4)  # frozen
code_block_5 = CodeBlock(c1=byJoinedCurves, a=pointAtParameter, par1=code_block_4) { isCCW(c1,a,par1); }
code_block_6 = CodeBlock { 4; }
byStartPointDirectionLength = Line.ByStartPointDirectionLength(startPoint=pointAtParameter, direction=code_block_5, length=code_block_6)
levels = Levels(index=0)
byLine = archilab.Revit.Elements.FamilyInstances.ByLine(familyType=family_types, line=byStartPointDirectionLength, level=levels)  # frozen
firstItem_2 = List.FirstItem(list=code_block_3.curve1)
code_block_7 = CodeBlock { 1; -40.594; }
byTangency = Line.ByTangency(curve=firstItem_2, parameter=code_block_7.out0)
startPoint = Curve.StartPoint(curve=firstItem_2)
endPoint = Curve.EndPoint(curve=firstItem_2)
byStartPointEndPoint = Line.ByStartPointEndPoint(startPoint=startPoint, endPoint=endPoint)
code_block_8 = CodeBlock { x = FamilyInstances.GetMaterials(fam); location = FamilyInstances.SetLocation(fam, (0..#10..1)); }  # unwired: fam
parse = Custom[Springs.InterferenceCheck.Parse]()  # Process a Revit interference check (HTML file) and extract the interference categories, all affected elements and the total number of clashes. If you are executing from a document different than the one the error report belongs to, be sure to set "fetch_elements" to false.; unwired: report
byPointAndLevel = FamilyInstance.ByPointAndLevel(familyType=family_types, point=pointAtParameter, level=levels)
code_block_9 = CodeBlock { 90; }
setRotation = FamilyInstance.SetRotation(familyInstance=byPointAndLevel, degree=code_block_9)
code_block_10 = CodeBlock {  }

# group: Define Coordinates
number_slider_2 = DoubleSlider(40, range=0..100 step 1)  # graph input; frozen
number_slider_3 = DoubleSlider(73, range=0..100 step 1)  # graph input; frozen

# group: Create Corner Points
byCoordinates = Point.ByCoordinates()
byCoordinates_2 = Point.ByCoordinates(x=number_slider_2)
byCoordinates_3 = Point.ByCoordinates(x=number_slider_2, y=number_slider_3)
byCoordinates_4 = Point.ByCoordinates(y=number_slider_3)

# group: Create Lines from Points
byStartPointEndPoint_2 = Line.ByStartPointEndPoint(startPoint=byCoordinates, endPoint=byCoordinates_2)
byStartPointEndPoint_3 = Line.ByStartPointEndPoint(startPoint=byCoordinates_2, endPoint=byCoordinates_3)
byStartPointEndPoint_4 = Line.ByStartPointEndPoint(startPoint=byCoordinates_3, endPoint=byCoordinates_4)
byStartPointEndPoint_5 = Line.ByStartPointEndPoint(startPoint=byCoordinates_4, endPoint=byCoordinates)

# group: Create Outline
create = List.Create(item0=byStartPointEndPoint_2, item1=byStartPointEndPoint_3, item2=byStartPointEndPoint_4, item3=byStartPointEndPoint_5)  # frozen
byJoinedCurves_2 = PolyCurve.ByJoinedCurves(curves=create)

all_elements_of_model_category_2 = ModelCategoriesCollect(index=84)
code_block_11 = CodeBlock(t5=all_elements_of_model_category_2)  # frozen
# ---------- code_block_11.designscript (19 lines) ----------
t1 = t5;
t2 = t1;
x = t2;
listYo = List.Transpose(x);
get = List.GetItemAtIndex(listYo, 0);
t3 = List.GetItemAtIndex(t2, 1);
//change this to move to a different room;
t4 = Elements.Element.Geometry(get);
polySurface1 = PolySurface.BySolid(t4);
surface1 = PolySurface.Surfaces(polySurface1);
t6 = 7;
//change this to find the right surface;
surface11 = surface1;
t21 = t6;
t11 = List.GetItemAtIndex(surface11@L2<1>, t21);
t31 = List.FirstItem(t11);
t41 = List.FirstItem(t31);
curve1 = Surface.PerimeterCurves(t41);
polyCurve1 = PolyCurve.ByJoinedCurves(curve1, 0.001);
# ----------------------------------------

# group: Create Floor
floor_types = FloorTypes(index=2)  # graph input; frozen
levels_2 = Levels(index=0)  # graph input
byOutlineTypeAndLevel = Floor.ByOutlineTypeAndLevel(outlineCurves=code_block_11.polyCurve1, floorType=floor_types, level=levels_2)  # frozen

# group: Create Walls from Lines
levels_3 = Levels(index=0)  # graph input
levels_4 = Levels(index=1)  # graph input
wall_types = WallTypes(index=26)  # graph input
byCurveAndLevels = Wall.ByCurveAndLevels(c=byStartPointEndPoint_2, startLevel=levels_3, endLevel=levels_4, wallType=wall_types)  # frozen
byCurveAndLevels_2 = Wall.ByCurveAndLevels(c=byStartPointEndPoint_3, startLevel=levels_3, endLevel=levels_4, wallType=wall_types)  # frozen
byCurveAndLevels_3 = Wall.ByCurveAndLevels(c=byStartPointEndPoint_4, startLevel=levels_3, endLevel=levels_4, wallType=wall_types)  # frozen
byCurveAndLevels_4 = Wall.ByCurveAndLevels(c=byStartPointEndPoint_5, startLevel=levels_3, endLevel=levels_4, wallType=wall_types)  # frozen

watch_3d = Watch3D(code_block_11.polyCurve1)

# group: Create Roof
string = StringInput("Generic - 9\"")  # graph input
byName = RoofType.ByName(name=string)  # frozen
levels_5 = Levels(index=1)  # graph input
byOutlineTypeAndLevel_2 = Roof.ByOutlineTypeAndLevel(outline=code_block_11.polyCurve1, roofType=byName, level=levels_5)  # frozen

levels_6 = Levels(index=0)
levels_7 = Levels(index=1)
wall_types_2 = WallTypes(index=10)  # graph input
byCurveAndLevels_5 = Wall.ByCurveAndLevels(c=code_block_11.polyCurve1, startLevel=levels_6, endLevel=levels_7, wallType=wall_types_2)
all_elements_of_model_category_3 = ModelCategoriesCollect(index=84)
code_block_12 = CodeBlock(t1=all_elements_of_model_category_3)  # same code as code_block_2
number_slider_4 = DoubleSlider(7, range=0..100 step 0.1)
code_block_13 = CodeBlock(surface1=code_block_12.surface1, t2=number_slider_4)  # same code as code_block_3
byJoinedCurves_3 = PolyCurve.ByJoinedCurves(curves=code_block_13.curve1)
code_block_14 = CodeBlock { 0; 1; 2; 3; 4; 5; 6; 7; 8; 9; }
getItemAtIndex = List.GetItemAtIndex(list=code_block_13.curve1, index=code_block_14.out0)
levels_8 = Levels(index=0)
levels_9 = Levels(index=1)
wall_types_3 = WallTypes(index=10)  # graph input
byCurveAndLevels_6 = Wall.ByCurveAndLevels(c=getItemAtIndex, startLevel=levels_8, endLevel=levels_9, wallType=wall_types_3)
getItemAtIndex_2 = List.GetItemAtIndex(list=code_block_13.curve1, index=code_block_14.out1)
byCurveAndLevels_7 = Wall.ByCurveAndLevels(c=getItemAtIndex_2, startLevel=levels_8, endLevel=levels_9, wallType=wall_types_3)
getItemAtIndex_3 = List.GetItemAtIndex(list=code_block_13.curve1, index=code_block_14.out2)
byCurveAndLevels_8 = Wall.ByCurveAndLevels(c=getItemAtIndex_3, startLevel=levels_8, endLevel=levels_9, wallType=wall_types_3)
getItemAtIndex_4 = List.GetItemAtIndex(list=code_block_13.curve1, index=code_block_14.out3)
byCurveAndLevels_9 = Wall.ByCurveAndLevels(c=getItemAtIndex_4, startLevel=levels_8, endLevel=levels_9, wallType=wall_types_3)
getItemAtIndex_5 = List.GetItemAtIndex(list=code_block_13.curve1, index=code_block_14.out4)
byCurveAndLevels_10 = Wall.ByCurveAndLevels(c=getItemAtIndex_5, startLevel=levels_8, endLevel=levels_9, wallType=wall_types_3)
getItemAtIndex_6 = List.GetItemAtIndex(list=code_block_13.curve1, index=code_block_14.out7)
byCurveAndLevels_11 = Wall.ByCurveAndLevels(c=getItemAtIndex_6, startLevel=levels_8, endLevel=levels_9, wallType=wall_types_3)
getItemAtIndex_7 = List.GetItemAtIndex(list=code_block_13.curve1, index=code_block_14.out8)
byCurveAndLevels_12 = Wall.ByCurveAndLevels(c=getItemAtIndex_7, startLevel=levels_8, endLevel=levels_9, wallType=wall_types_3)
getItemAtIndex_8 = List.GetItemAtIndex(list=code_block_13.curve1, index=code_block_14.out9)
byCurveAndLevels_13 = Wall.ByCurveAndLevels(c=getItemAtIndex_8, startLevel=levels_8, endLevel=levels_9, wallType=wall_types_3)
getItemAtIndex_9 = List.GetItemAtIndex(list=code_block_13.curve1, index=code_block_14.out6)
byCurveAndLevels_14 = Wall.ByCurveAndLevels(c=getItemAtIndex_9, startLevel=levels_8, endLevel=levels_9, wallType=wall_types_3)
getItemAtIndex_10 = List.GetItemAtIndex(list=code_block_13.curve1, index=code_block_14.out5)
byCurveAndLevels_15 = Wall.ByCurveAndLevels(c=getItemAtIndex_10, startLevel=levels_8, endLevel=levels_9, wallType=wall_types_3)
location = FamilyInstance.Location()  # unwired: familyInstance
byStartPointDirectionLength_2 = Line.ByStartPointDirectionLength(startPoint=location)  # unwired: direction
byLine_2 = Grid.ByLine(line=byStartPointDirectionLength_2)
select_model_elements_2 = DSModelElementsSelection()  # 42 picked in the model
name = Element.Name(element=select_model_elements_2)
code_block_15 = CodeBlock { "Model Lines"; }
equals = List.Equals(objectA=name@L1, objectB=code_block_15)
filterByBoolMask = List.FilterByBoolMask(list=select_model_elements_2, mask=equals)
facingOrientation = FamilyInstance.FacingOrientation()  # unwired: familyInstance
rotate_family = Custom[Rotate Family]()  # This node will rotate a family in Revit around a given axis by supplied angle (in radians). Please remember that every time you run your definition it will rotate family by given angle every time.; unwired: ElementId, Axis, Angle
elevation = Level.Elevation()  # unwired: level
