# Dynamo graph Grid Layout_004.dyn (Dynamo 2.1.0.5784)

code_block = CodeBlock { 0; }
code_block_2 = CodeBlock { a=25; }
# note: Cool. So this Map that I found from Dynamo Forum: https://forum.dynamobim.com/t/grid-formula-array/23856
# Creates a grid in a specific frequency. If we were to dumb down the code to create something static how would that look? 9:45AM
number_slider = DoubleSlider(500, range=500..20000 step 50)
code_block_3 = CodeBlock(a=code_block_2, n=number_slider) { a..n..80; b = a- 50; b..n..5; }
count = List.Count(list=code_block_3.out0)
takeItems = List.TakeItems(list=code_block_3.out2, amount=count)
list_create = List.Create(item0=count, item1=takeItems)
flatten = List.Flatten(list=list_create)
code_block_4 = CodeBlock(a=flatten) { 1..List.Count(a); }
takeItems_2 = List.TakeItems(list=flatten, amount=code_block_4)
sum = Math.Sum(values=takeItems_2)
addItemToFront = List.AddItemToFront(item=code_block, list=sum)
grid_length_slider = DoubleSlider(-30, range=-70..250 step 10)
code_block_5 = CodeBlock { 0; }
byCoordinates = Point.ByCoordinates(x=addItemToFront, y=grid_length_slider, z=code_block_5)
grid_length_slider_2 = DoubleSlider(70, range=0..250 step 10)
code_block_6 = CodeBlock { 0; }
byCoordinates_2 = Point.ByCoordinates(x=addItemToFront, y=grid_length_slider_2, z=code_block_6)
byStartPointEndPoint = Grid.ByStartPointEndPoint(start=byCoordinates, end=byCoordinates_2)
code_block_7 = CodeBlock(a=code_block_2, n=number_slider) { a..n..50; }
