# Dynamo graph Grid Layout_007.dyn (Dynamo 2.1.0.5784)

# note: Cool. So this Map that I found from Dynamo Forum: https://forum.dynamobim.com/t/grid-formula-array/23856
# Creates a grid in a specific frequency. If we were to dumb down the code to create something static how would that look? 9:45AM

code_block = CodeBlock { 0; }
number_of_horizontal_gridlines = DoubleSlider(8, range=1..25 step 1)  # "Number of Horizontal Gridlines Slider"
gridspacing_number_from_feet_and = LengthFromString(Value=5.0292)  # "gridSpacing (Number From Feet and Inches)"
code_block_2 = CodeBlock(horizontalGridNumber=number_of_horizontal_gridlines, gridSpacing=gridspacing_number_from_feet_and) { startingNum = (((horizontalGridNumber * gridSpacing)/2)*-1); }
sequence = Sequence(start=code_block_2, amount=number_of_horizontal_gridlines, step=gridspacing_number_from_feet_and)
addItemToFront = List.AddItemToFront(item=code_block, list=sequence)
grid_length_slider = DoubleSlider(-30, range=-70..250 step 10)
code_block_3 = CodeBlock { 0; }
byCoordinates = Point.ByCoordinates(x=addItemToFront, y=grid_length_slider, z=code_block_3)
grid_length_slider_2 = DoubleSlider(70, range=0..250 step 10)
code_block_4 = CodeBlock { 0; }
byCoordinates_2 = Point.ByCoordinates(x=addItemToFront, y=grid_length_slider_2, z=code_block_4)
byStartPointEndPoint = Grid.ByStartPointEndPoint(start=byCoordinates, end=byCoordinates_2)
code_block_5 = CodeBlock()
# ---------- code_block_5.designscript (6 lines) ----------
//the Starting number
-150;
//The number of Gridlines horizontally
16;
//the number of spacing
25;
# ----------------------------------------
starting_number_slider = DoubleSlider(-280, range=-300..100 step 25)
spacing_between_grid_slider = DoubleSlider(35, range=0..45 step 2)
