# Dynamo graph Grid Layout_008.dyn (Dynamo 2.1.0.5784)

# note: Cool. So this Map that I found from Dynamo Forum: https://forum.dynamobim.com/t/grid-formula-array/23856
# Creates a grid in a specific frequency. If we were to dumb down the code to create something static how would that look? 9:45AM

grid_length_slider = DoubleSlider(-70, range=-70..250 step 10)
code_block = CodeBlock { 0; }
number_of_horizontal_gridlines = DoubleSlider(8, range=0..26 step 2)  # "Number of Horizontal Gridlines Slider"
gridspacing_number_from_feet_and = LengthFromString(Value=5.0292)  # "gridSpacing (Number From Feet and Inches)"
code_block_2 = CodeBlock(verticleGridNumber=number_of_horizontal_gridlines, gridSpacing=gridspacing_number_from_feet_and) { startingNum = (((verticleGridNumber * gridSpacing)/2)*-1); }
sequence = Sequence(start=code_block_2, amount=number_of_horizontal_gridlines, step=gridspacing_number_from_feet_and)
addItemToFront = List.AddItemToFront(item=code_block, list=sequence)
code_block_3 = CodeBlock { 0; }
byCoordinates = Point.ByCoordinates(x=grid_length_slider, y=addItemToFront, z=code_block_3)
grid_length_slider_2 = DoubleSlider(60, range=0..250 step 10)
# note: What happens when you get rid of X?
byCoordinates_2 = Point.ByCoordinates(x=grid_length_slider_2, y=addItemToFront, z=code_block_3)
byStartPointEndPoint = Grid.ByStartPointEndPoint(start=byCoordinates, end=byCoordinates_2)
code_block_4 = CodeBlock { 0; }
number_of_horizontal_gridlines_2 = DoubleSlider(8, range=0..26 step 2)  # "Number of Horizontal Gridlines Slider"
gridspacing_number_from_feet_and_2 = LengthFromString(Value=5.0292)  # "gridSpacing (Number From Feet and Inches)"
code_block_5 = CodeBlock(horizontalGridNumber=number_of_horizontal_gridlines_2, gridSpacing=gridspacing_number_from_feet_and_2) { startingNum = (((horizontalGridNumber * gridSpacing)/2)*-1); }
sequence_2 = Sequence(start=code_block_5, amount=number_of_horizontal_gridlines_2, step=gridspacing_number_from_feet_and_2)
addItemToFront_2 = List.AddItemToFront(item=code_block_4, list=sequence_2)
grid_length_slider_3 = DoubleSlider(-70, range=-70..250 step 10)
code_block_6 = CodeBlock { 0; }
byCoordinates_3 = Point.ByCoordinates(x=addItemToFront_2, y=grid_length_slider_3, z=code_block_6)
grid_length_slider_4 = DoubleSlider(60, range=0..250 step 10)
byCoordinates_4 = Point.ByCoordinates(x=addItemToFront_2, y=grid_length_slider_4, z=code_block_6)
byStartPointEndPoint_2 = Grid.ByStartPointEndPoint(start=byCoordinates_3, end=byCoordinates_4)
