# Dynamo graph Grid Layout_010.dyn (Dynamo 2.1.0.5784)

# note: Cool. So this Map that I found from Dynamo Forum: https://forum.dynamobim.com/t/grid-formula-array/23856
# Creates a grid in a specific frequency. If we were to dumb down the code to create something static how would that look? 9:45AM

grid_length_slider = DoubleSlider(-70, range=-70..250 step 10)
code_block = CodeBlock { 0; }
# note: Verticle Grids
number_of_horizontal_gridlines = DoubleSlider(8, range=0..26 step 2)  # "Number of Horizontal Gridlines Slider"
gridspacing_number_from_feet_and = LengthFromString(Value=5.0292)  # "gridSpacing (Number From Feet and Inches)"
code_block_2 = CodeBlock(verticleGridNumber=number_of_horizontal_gridlines, gridSpacing=gridspacing_number_from_feet_and) { startingNum = (((verticleGridNumber * gridSpacing)/2)*-1); }
sequence = Sequence(start=code_block_2, amount=number_of_horizontal_gridlines, step=gridspacing_number_from_feet_and)
addItemToFront = List.AddItemToFront(item=code_block, list=sequence)
code_block_3 = CodeBlock { 0; }
byCoordinates = Point.ByCoordinates(x=grid_length_slider, y=addItemToFront, z=code_block_3)
grid_length_slider_2 = DoubleSlider(60, range=0..250 step 10)
# note: What happens when you get rid of X?
byCoordinates_2 = Point.ByCoordinates(x=grid_length_slider_2, y=addItemToFront, z=code_block_3)
byStartPointEndPoint = Grid.ByStartPointEndPoint(start=byCoordinates, end=byCoordinates_2)
code_block_4 = CodeBlock { 0; }
# note: Horizontal Grids
number_of_horizontal_gridlines_2 = DoubleSlider(8, range=0..26 step 2)  # "Number of Horizontal Gridlines Slider"
gridspacing_number_from_feet_and_2 = LengthFromString(Value=5.0292)  # "gridSpacing (Number From Feet and Inches)"
code_block_5 = CodeBlock(horizontalGridNumber=number_of_horizontal_gridlines_2, gridSpacing=gridspacing_number_from_feet_and_2) { startingNum = (((horizontalGridNumber * gridSpacing)/2)*-1); }
sequence_2 = Sequence(start=code_block_5, amount=number_of_horizontal_gridlines_2, step=gridspacing_number_from_feet_and_2)
addItemToFront_2 = List.AddItemToFront(item=code_block_4, list=sequence_2)
grid_length_slider_3 = DoubleSlider(-70, range=-70..250 step 10)
code_block_6 = CodeBlock { 0; }
byCoordinates_3 = Point.ByCoordinates(x=addItemToFront_2, y=grid_length_slider_3, z=code_block_6)
grid_length_slider_4 = DoubleSlider(60, range=0..250 step 10)
byCoordinates_4 = Point.ByCoordinates(x=addItemToFront_2, y=grid_length_slider_4, z=code_block_6)
byStartPointEndPoint_2 = Grid.ByStartPointEndPoint(start=byCoordinates_3, end=byCoordinates_4)
getByNumber = Custom[Room.GetByNumber]()  # This will obtain room by its number; unwired: roomNumber
code_block_7 = CodeBlock { "G".."N"; }
add = code_block_7 + code_block_7
getByName = Custom[grid.GetByName](gridName=add)  # Gets a grids in model by name
code_block_8 = CodeBlock { "H".."A"; "Name"; }
setParameterByName = Element.SetParameterByName(element=getByName, parameterName=code_block_8.out1, value=code_block_8.out0)  # frozen
code_block_9 = CodeBlock { "O".."V"; }
getByName_2 = Custom[grid.GetByName](gridName=code_block_9)
code_block_10 = CodeBlock { 1..8; "Name"; }
toString = Custom[Springs.Number.ToString](num=code_block_10.out0)  # Converts the input number(s) to string. You can optionally limit the number of digits.
setParameterByName_2 = Element.SetParameterByName(element=getByName_2, parameterName=code_block_10.out1, value=toString)
