# Dynamo graph Grid Layout_011.dyn (Dynamo 2.1.0.5784)

# note: Cool. So this Map that I found from Dynamo Forum: https://forum.dynamobim.com/t/grid-formula-array/23856
# Creates a grid in a specific frequency. If we were to dumb down the code to create something static how would that look? 9:45AM

# note: Verticle Grids
number_of_horizontal_gridlines = DoubleSlider(8, range=0..26 step 2)  # "Number of Horizontal Gridlines Slider"
code_block = CodeBlock { "G".."N"; }
add = code_block + code_block
getByName = Custom[grid.GetByName](gridName=add)
code_block_2 = CodeBlock { 0; }
# note: Horizontal Grids
number_of_horizontal_gridlines_2 = DoubleSlider(8, range=0..26 step 2)  # "Number of Horizontal Gridlines Slider"
gridspacing_number_from_feet_and = LengthFromString(Value=5.0292)  # "gridSpacing (Number From Feet and Inches)"
code_block_3 = CodeBlock(horizontalGridNumber=number_of_horizontal_gridlines_2, gridSpacing=gridspacing_number_from_feet_and) { startingNum = (((horizontalGridNumber * gridSpacing)/2)*-1); }
sequence = Sequence(start=code_block_3, amount=number_of_horizontal_gridlines_2, step=gridspacing_number_from_feet_and)
addItemToFront = List.AddItemToFront(item=code_block_2, list=sequence)
grid_length_slider = DoubleSlider(-70, range=-70..250 step 10)
code_block_4 = CodeBlock { 0; }
byCoordinates = Point.ByCoordinates(x=addItemToFront, y=grid_length_slider, z=code_block_4)
grid_length_slider_2 = DoubleSlider(60, range=0..250 step 10)
# note: What happens when you get rid of X?
byCoordinates_2 = Point.ByCoordinates(x=addItemToFront, y=grid_length_slider_2, z=code_block_4)
byStartPointEndPoint = Grid.ByStartPointEndPoint(start=byCoordinates, end=byCoordinates_2)
code_block_5 = CodeBlock { "H".."A"; "Name"; }
setParameterByName = Element.SetParameterByName(element=byStartPointEndPoint, parameterName=code_block_5.out1, value=code_block_5.out0)  # frozen
grid_length_slider_3 = DoubleSlider(-70, range=-70..250 step 10)
code_block_6 = CodeBlock { 0; }
code_block_7 = CodeBlock { numOfVerticleGrids = 8; 1..numOfVerticleGrids; }
gridspacing_number_from_feet_and_2 = LengthFromString(Value=5.0292)  # "gridSpacing (Number From Feet and Inches)"
code_block_8 = CodeBlock(verticleGridNumber=code_block_7.numOfVerticleGrids, gridSpacing=gridspacing_number_from_feet_and_2) { startingNum = (((verticleGridNumber * gridSpacing)/2)*-1); }
sequence_2 = Sequence(start=code_block_8, amount=code_block_7.numOfVerticleGrids, step=gridspacing_number_from_feet_and_2)
addItemToFront_2 = List.AddItemToFront(item=code_block_6, list=sequence_2)
code_block_9 = CodeBlock { 0; }
byCoordinates_3 = Point.ByCoordinates(x=grid_length_slider_3, y=addItemToFront_2, z=code_block_9)
grid_length_slider_4 = DoubleSlider(60, range=0..250 step 10)
byCoordinates_4 = Point.ByCoordinates(x=grid_length_slider_4, y=addItemToFront_2, z=code_block_9)
byStartPointEndPoint_2 = Grid.ByStartPointEndPoint(start=byCoordinates_3, end=byCoordinates_4)  # frozen
code_block_10 = CodeBlock { "Name"; }
toString = Custom[Springs.Number.ToString](num=code_block_7.out1)  # Converts the input number(s) to string. You can optionally limit the number of digits.
setParameterByName_2 = Element.SetParameterByName(element=byStartPointEndPoint_2, parameterName=code_block_10, value=toString)
# note: Watch the change to make sure the new outputs are updated!
getParameterValueByName = Element.GetParameterValueByName(element=byStartPointEndPoint_2, parameterName=code_block_10)
getByStringName = Custom[Grid.GetByStringName](gridName=add)  # Returns the names of grids in current model
getParameterValueByName_2 = Element.GetParameterValueByName(element=getByStringName, parameterName=code_block_5.out1)
