# Dynamo graph Grid Layout_013.dyn (Dynamo 2.1.0.5784)

# note: Cool. So this Map that I found from Dynamo Forum: https://forum.dynamobim.com/t/grid-formula-array/23856
# Creates a grid in a specific frequency. If we were to dumb down the code to create something static how would that look? 9:45AM

# note: Verticle Grids
number_of_horizontal_gridlines = DoubleSlider(8, range=0..26 step 2)  # "Number of Horizontal Gridlines Slider"
grid_length_slider = DoubleSlider(-70, range=-70..250 step 10)
code_block = CodeBlock { numOfVerticleGrids = 8; 1..numOfVerticleGrids; }
gridspacing_number_from_feet_and = LengthFromString(Value=5.0292)  # "gridSpacing (Number From Feet and Inches)"
code_block_2 = CodeBlock(verticleGridNumber=code_block.numOfVerticleGrids, gridSpacing=gridspacing_number_from_feet_and) { startingNum = (((verticleGridNumber * gridSpacing)/2)*-1); }
sequence = Sequence(start=code_block_2, amount=code_block.numOfVerticleGrids, step=gridspacing_number_from_feet_and)
code_block_3 = CodeBlock { 0; }
byCoordinates = Point.ByCoordinates(x=grid_length_slider, y=sequence, z=code_block_3)
grid_length_slider_2 = DoubleSlider(60, range=0..250 step 10)
# note: What happens when you get rid of X?
byCoordinates_2 = Point.ByCoordinates(x=grid_length_slider_2, y=sequence, z=code_block_3)
# note: Watch the change to make sure the new outputs are updated!
byStartPointEndPoint = Grid.ByStartPointEndPoint(start=byCoordinates, end=byCoordinates_2)
code_block_4 = CodeBlock { "Name"; }
toString = Custom[Springs.Number.ToString](num=code_block.out1)  # Converts the input number(s) to string. You can optionally limit the number of digits.
code_block_5 = CodeBlock { "-1"; }
add = toString + code_block_5
setParameterByName = Element.SetParameterByName(element=byStartPointEndPoint, parameterName=code_block_4, value=add)
getParameterValueByName = Element.GetParameterValueByName(element=setParameterByName, parameterName=code_block_4)
# note: Horizontal Grids
number_of_horizontal_gridlines_2 = DoubleSlider(8, range=0..26 step 2)  # "Number of Horizontal Gridlines Slider"
gridspacing_number_from_feet_and_2 = LengthFromString(Value=5.0292)  # "gridSpacing (Number From Feet and Inches)"
code_block_6 = CodeBlock(horizontalGridNumber=number_of_horizontal_gridlines_2, gridSpacing=gridspacing_number_from_feet_and_2) { startingNum = (((horizontalGridNumber * gridSpacing)/2)*-1); }
sequence_2 = Sequence(start=code_block_6, amount=number_of_horizontal_gridlines_2, step=gridspacing_number_from_feet_and_2)
grid_length_slider_3 = DoubleSlider(-70, range=-70..250 step 10)
code_block_7 = CodeBlock { 0; }
byCoordinates_3 = Point.ByCoordinates(x=sequence_2, y=grid_length_slider_3, z=code_block_7)
grid_length_slider_4 = DoubleSlider(60, range=0..250 step 10)
byCoordinates_4 = Point.ByCoordinates(x=sequence_2, y=grid_length_slider_4, z=code_block_7)
byStartPointEndPoint_2 = Grid.ByStartPointEndPoint(start=byCoordinates_3, end=byCoordinates_4)
code_block_8 = CodeBlock { "Name"; "H".."A"; }
code_block_9 = CodeBlock { "-1"; }
add_2 = code_block_8.out1 + code_block_9
setParameterByName_2 = Element.SetParameterByName(element=byStartPointEndPoint_2, parameterName=code_block_8.out0, value=add_2)
getParameterValueByName_2 = Element.GetParameterValueByName(element=setParameterByName_2, parameterName=code_block_8.out1)

# group: Can use to Find grid name from parameter
code_block_10 = CodeBlock { "G".."N"; }
add_3 = code_block_10 + code_block_10
getByStringName = Custom[Grid.GetByStringName](gridName=add_3)  # Returns the names of grids in current model

code_block_11 = CodeBlock {  }
