# Dynamo graph Grid Layout_DynamoPlayer_Square.dyn (Dynamo 2.1.0.5784)

# group: User input
numOfVerticleGrids = DoubleSlider(14, range=0..26 step 1)  # graph input

# group: Verticle Grids
verticle_grid_length_slider = DoubleSlider(-120, range=-250..250 step 10)  # graph input
# note: Verticle Grids
# note: Begin with a fresh document! But we will work with this one, to show you how to troubleshoot if you name things wrong or want to alter the grid ;)
code_block = CodeBlock(numOfVerticleGrids=numOfVerticleGrids) { a = numOfVerticleGrids; 1..a; }
gridspacing_number_from_feet_and = LengthFromString(Value=5.0292)  # "gridSpacing (Number From Feet and Inches)"
code_block_2 = CodeBlock(verticleGridNumber=code_block.a, gridSpacing=gridspacing_number_from_feet_and) { startingNum = (((verticleGridNumber * gridSpacing)/2)*-1); }
sequence = Sequence(start=code_block_2, amount=code_block.a, step=gridspacing_number_from_feet_and)
code_block_3 = CodeBlock { 0; }
byCoordinates = Point.ByCoordinates(x=verticle_grid_length_slider, y=sequence, z=code_block_3)
verticle_grid_length_slider_2 = DoubleSlider(100, range=0..250 step 10)  # graph input
# note: What happens when you get rid of X?
byCoordinates_2 = Point.ByCoordinates(x=verticle_grid_length_slider_2, y=sequence, z=code_block_3)

# group: Horizontal Grids
# note: Horizontal Grids
number_of_horizontal_gridlines = DoubleSlider(8, range=0..26 step 2)  # "Number of Horizontal Gridlines Slider"
gridspacing_number_from_feet_and_2 = LengthFromString(Value=5.0292)  # "gridSpacing (Number From Feet and Inches)"
code_block_4 = CodeBlock(horizontalGridNumber=code_block.a, gridSpacing=gridspacing_number_from_feet_and_2) { startingNum = (((horizontalGridNumber * gridSpacing)/2)*-1); }
sequence_2 = Sequence(start=code_block_4, amount=code_block.a, step=gridspacing_number_from_feet_and_2)
horizontal_grid_length_slider = DoubleSlider(-130, range=-250..250 step 10)  # graph input
code_block_5 = CodeBlock { 0; }
byCoordinates_3 = Point.ByCoordinates(x=sequence_2, y=horizontal_grid_length_slider, z=code_block_5)
horizontal_grid_length_slider_2 = DoubleSlider(110, range=0..250 step 10)  # graph input
# note: What happens when you get rid of X?
byCoordinates_4 = Point.ByCoordinates(x=sequence_2, y=horizontal_grid_length_slider_2, z=code_block_5)

# group: OUTPUT
byStartPointEndPoint = Grid.ByStartPointEndPoint(start=byCoordinates, end=byCoordinates_2)

# group: Creates New Naming for Verticle Grids
# note: Watch the change to make sure the new outputs are updated!
code_block_6 = CodeBlock { "Name"; }
toString = Custom[Springs.Number.ToString](num=code_block.out1)  # Converts the input number(s) to string. You can optionally limit the number of digits.

verticle_string = StringInput("")  # graph input

# group: RESET NAMING
add = toString + verticle_string
code_block_7 = CodeBlock { "*"; }

# group (continued): Creates New Naming for Verticle Grids
setParameterByName = Element.SetParameterByName(element=byStartPointEndPoint, parameterName=code_block_6, value=add)  # graph output
getParameterValueByName = Element.GetParameterValueByName(element=setParameterByName, parameterName=code_block_6)

# group: OUTPUT
byStartPointEndPoint_2 = Grid.ByStartPointEndPoint(start=byCoordinates_3, end=byCoordinates_4)

# group: Creating Dictionary for "A" Naming
code_block_8 = CodeBlock { 1..26; "A".."Z"; }
toString_2 = Custom[Springs.Number.ToString](num=code_block_8.out0)
# note: To FIND the Dictionary.ByKeysValues,
# just search for "keys" and it will be in the library
byKeysValues = DesignScript.Builtin.Dictionary.ByKeysValues(keys=toString_2, values=code_block_8.out1)
toString_3 = Custom[Springs.Number.ToString](num=code_block.out1)
# note: Now the keys are set to the numOfVerticleGrids that the user defines.
# This is to automate the naming. Change one input and the rest solves for you.
valueAtKey = DesignScript.Builtin.Dictionary.ValueAtKey(dictionary=byKeysValues, key=toString_3)

horizontal_string = StringInput("")  # graph input

# group: RESET NAMING
# note: Whatever is in the {?} should match the user input number, if running correctly.
add_2 = valueAtKey + horizontal_string
code_block_9 = CodeBlock { "*"; }

# group: Creates New Naming for Horizontal Grids
code_block_10 = CodeBlock { "Name"; }
setParameterByName_2 = Element.SetParameterByName(element=byStartPointEndPoint_2, parameterName=code_block_10, value=add_2)  # graph output
getParameterValueByName_2 = Element.GetParameterValueByName(element=setParameterByName_2, parameterName=code_block_10)

# group: Can use to Find grid name from parameter
# note: Cool. So this Map that I found from Dynamo Forum: https://forum.dynamobim.com/t/grid-formula-array/23856
# Creates a grid in a specific frequency. If we were to dumb down the code to create something static how would that look? 9:45AM
code_block_11 = CodeBlock { "G".."N"; }
add_3 = code_block_11 + code_block_11
getByStringName = Custom[Grid.GetByStringName](gridName=add_3)  # Returns the names of grids in current model
