# Dynamo graph Oct 23 Notes.dyn (Dynamo 2.1.0.5784)

# group: Quicker way to change names
code_block = CodeBlock { 100..150..5; }
code_block_2 = CodeBlock { "A".."H"; }
# note: Could be cool if my Dynamo 2.0 worked. Unknown reason why "node to code" is not an available option.
# Just as it is a mystery why the Library will no longer display on Revit 2018.2.
# Will upgrade to Revit 2018.3 to see if it resolves any of the visual scripting issues and errors.
add = code_block@L1 + code_block_2
watch = Watch(add)

# group: NODE TO CODE_ Quicker way to change names
# note: Could be cool if my Dynamo 2.0 worked. Unknown reason why "node to code" is not an available option.
# Just as it is a mystery why the Library will no longer display on Revit 2018.2.
# Will upgrade to Revit 2018.3 to see if it resolves any of the visual scripting issues and errors.
code_block_3 = CodeBlock { t1 = (100..150..5); t2 = ("A".."H"); t3 = t1@L1<1> + t2; }
watch_2 = Watch(code_block_3.t3)

# group: Happy medium between the two
# note: Source: John Pierson
# https://www.youtube.com/watch?v=hRGIk_P1OPA
code_block_4 = CodeBlock { 100..150..3; "A".."H"; }
code_block_5 = CodeBlock(t1=code_block_4.out0, t2=code_block_4.out1)
# ---------- code_block_5.designscript (3 lines) ----------
//t1 = (100..150..2);
//t2 = ("A".."H");
t3 = t1@L1<1> + t2;
# ----------------------------------------
